# Grasshopper definition robotic_drawing.ghx (Grasshopper 1.0.7)
# Copyright: © 2021 Ko Tsuruta
# plug-ins: KUKA|prc - parametric robot control

filename = Panel("test")
filename_2 = Panel("test_manual.src")
kr6_10_r1100_2 = AgilusKR610R11002Robot(infiniterot=False)
toggle = BooleanToggle(True)
save = Button()
save_2 = Button()

pt = ConstructPoint(XCoordinate=Slider(500, range=0..1000), YCoordinate=0, ZCoordinate=Slider(500, range=0..1000))
X = UnitX(Factor=1)
Y = UnitY(Factor=1)
pl = ConstructPlane(Origin=pt, XAxis=expr("-x", X), YAxis=Y)
xy = XYPlane(Origin=pt)
xz = XZPlane(Origin=pt)
rotate = Rotate(Geometry=xy, Angle=3.141592654, Plane=xz)  # -> Geometry, Transform
lin_move = LINearMovementKUKAPrc(TargetAsPlane=pl, extaxenabled=False, interpolation="C_DIS")

# ----
# KRL
kuka_code = GhPythonScript(filename=filename_2, save=save_2)  # -> out, KRL; inputs save: Boolean
# ---------- kuka_code: Python ----------
"""ABOUT
    This file is an example template of a python file.
"""

# ------------------------------------------------------------------------------
# modules
# ------------------------------------------------------------------------------

import compas_ghpython
from krl import KukaPython


# ------------------------------------------------------------------------------
# hard code values & routines
# ------------------------------------------------------------------------------

compas_ghpython.utilities.unload_modules("krl")

_hardcode_value = 0
# tool coordinates
tx, ty, tz, ta, tb, tc = 0, 0, 0, 0, 0, 0
# base coordinates
bx, by, bz, ba, bb, bc = 0, 0, 0, 0, 0, 0

# ------------------------------------------------------------------------------
# functions
# ------------------------------------------------------------------------------

# ------------------------------------------------------------------------------
# classes
# ------------------------------------------------------------------------------

# ------------------------------------------------------------------------------
# run code
# ------------------------------------------------------------------------------

# create instance of KukaPython
k = KukaPython("my_kuka")

# set tool properties
#k.setToolNumber(0)
k.setToolCoordinates(tx, ty, tz, ta, tb, tc)

# set base properties
#k.setBaseNumber(0)
k.setBaseCoordinates(bx, by, bz, ba, bb, bc)

# run code

# save code
if save:
    KRL = k.saveFile(filename)
# ---------- end kuka_code ----------
panel = Panel("""&ACCESS RVP
&REL 1
&PARAM TEMPLATE = C:\KRC\Roboter\Template\vorgabe
&PARAM EDITMASK = *
DEF test ( )


;FOLD INI
;FOLD BASISTECH INI
GLOBAL INTERRUPT DECL 3 WHEN $STOPMESS==TRUE DO IR_STOPM ( )
INTERRUPT ON 3
BAS (#INITMOV,0 )
;ENDFOLD (BASISTECH INI)
;ENDFOLD (INI)

;FOLD STARTPOSITION - BASE IS 0, TOOL IS 0, SPEED IS 15%, POSITION IS A1 5,A2 -90,A3 100,A4 5,A5 10,A6 -5,E1 0,E2 0,E3 0,E4 0
$BWDSTART = FALSE
PDAT_ACT = {VEL 15,ACC 100,APO_DIST 50}
FDAT_ACT = {TOOL_NO 0,BASE_NO 0,IPO_FRAME #BASE}
BAS (#PTP_PARAMS,15)
PTP  {A1 5,A2 -90,A3 100,A4 5,A5 10,A6 -5,E1 0,E2 0,E3 0,E4 0}
;ENDFOLD

;FOLD LIN SPEED IS 0.25 m/sec, INTERPOLATION SETTINGS IN FOLD
$VEL.CP=0.25
$ADVANCE=3
;ENDFOLD

PTP {E6POS: X 500, Y 0, Z 500, A 0, B -90, C 0, E1 0, E2 0, E3 0, E4 0, S 'B 110'} C_PTP
LIN {E6POS: X 500, Y 0, Z 500, A 0, B -90, C 0, E1 0, E2 0, E3 0, E4 0} C_DIS
HALT

END""")
txt = Text(panel)
krl_code = KRLCodeKUKAPrc(KRLAsText=txt)
list = ValueList({"kuka prc": 0, "manual": 1}, selected="manual")
filter = StreamFilter(Gate=list, Stream0=lin_move, Stream1=krl_code)
kuka_prc = KUKAPrcCORE(
    SimulationSlider=Slider(0, range=0..1),
    KUKAPrcCommands=filter,
    Robot=kr6_10_r1100_2,
    SaveToggle=save,
    Filename=filename,
    PRC_BaseExpose=False,
    PRC_SaveNameExpose=True,
    PRCsettings="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")  # -> RobotGeometry, AnalysisOutput
